% Simulink data dictionary Flight_Contracts.sldd

ActuationPermit = Simulink.Bus()
  header: Bus: ContractHeader
  permit_epoch: uint32
  directive_epoch: uint32
  authority_epoch: uint32
  state_epoch: uint32
  reference_epoch: uint32
  permit_flags: uint32
  permit_expires_at_us: uint64
  reason_code: uint16
  output_policy_id: uint16

ActuatorCapability = Simulink.Bus()
  header: Bus: ContractHeader
  actuator_layout_id: uint32
  available_mask: uint32
  controllable_dof_mask: uint32
  degraded_dof_mask: uint32
  vehicle_extension: Bus: ProductActuatorCapability

ActuatorCommitReceipt = Simulink.Bus()
  header: Bus: ContractHeader
  applied_control_sequence: uint32
  permit_epoch: uint32
  directive_epoch: uint32
  authority_epoch: uint32
  state_epoch: uint32
  reference_epoch: uint32
  commit_time_us: uint64
  estimated_apply_time_us: uint64
  receipt_expires_at_us: uint64
  limit_flags: uint32
  output_policy_id: uint16
  result_code: uint16
  committed_demand: Bus: ProductActuatorDemand

ActuatorDemand = Simulink.Bus()
  header: Bus: ContractHeader
  actuator_layout_id: uint32
  valid_channel_mask: uint32
  permit_epoch: uint32
  directive_epoch: uint32
  authority_epoch: uint32
  state_epoch: uint32
  reference_epoch: uint32
  control_sequence: uint32
  demand_expires_at_us: uint64
  demand: Bus: ProductActuatorDemand

ActuatorHealth = Simulink.Bus()
  header: Bus: ContractHeader
  component_id: uint32
  last_error_code: uint32
  consecutive_error_count: uint32
  last_success_time_us: uint64
  last_heartbeat_time_us: uint64
  health_state: uint8
  reserved: uint8[7]

ActuatorStatus = Simulink.Bus()
  header: Bus: ContractHeader
  actuator_layout_id: uint32
  available_mask: uint32
  fault_mask: uint32
  feedback_valid_mask: uint32
  feedback: Bus: ProductActuatorFeedback

AirspeedSample = Simulink.Bus()
  header: Bus: ContractHeader
  sensor_instance_id: uint32
  calibration_version: uint32
  quality_flags: uint32
  true_airspeed_mps: single
  variance_m2ps2: single

AuthorityStatus = Simulink.Bus()
  header: Bus: ContractHeader
  authority_epoch: uint32
  authority_owner: uint16
  operation_mode: uint16
  selected_source_id: uint32
  flags: uint32
  reason_code: uint16
  reserved: uint16

AuthorizedMissionSnapshot = Simulink.Bus()
  header: Bus: ContractHeader
  mission_epoch: uint32
  authority_epoch: uint32
  directive_epoch: uint32
  state_epoch: uint32
  origin_id: uint32
  mission_id: uint32
  mission_revision: uint32
  mission_hash: uint32
  mission_expires_at_us: uint64
  current_item_id: uint32
  current_item_index: uint16
  reserved: uint16
  execution_token: uint64
  mission: Bus: ProductMissionPayload

AuthorizedOperatorInput = Simulink.Bus()
  header: Bus: ContractHeader
  authority_epoch: uint32
  selected_source_id: uint16
  authority_class: uint16
  input_layout_id: uint32
  payload: Bus: ProductOperatorInput

BaroSample = Simulink.Bus()
  header: Bus: ContractHeader
  sensor_instance_id: uint32
  calibration_version: uint32
  quality_flags: uint32
  altitude_m: single
  variance_m2: single

ClockDomainMappingStatus = Simulink.Bus()
  source_clock_domain_id: uint32
  source_reset_counter: uint32
  mapping_epoch: uint32
  local_time_epoch: uint32
  anchor_source_time_ns: uint64
  anchor_local_time_us: uint64
  source_rate_error_ppb: int32
  mapping_state: uint8
  reserved: uint8[3]
  uncertainty_ns: uint64
  last_sync_local_us: uint64
  valid_until_local_us: uint64

ClockInstant = Simulink.Bus()
  boot_id: uint64
  monotonic_us: uint64
  time_epoch: uint32
  reserved: uint32

ClockMappingState = enum(DataScope="Imported", HeaderFile="common_base.h", DefaultValue="CLOCK_MAPPING_UNSYNCED")
  CLOCK_MAPPING_UNSYNCED = 0
  CLOCK_MAPPING_ACQUIRING = 1
  CLOCK_MAPPING_LOCKED = 2
  CLOCK_MAPPING_HOLDOVER = 3
  CLOCK_MAPPING_DEGRADED = 4
  CLOCK_MAPPING_INVALID = 5

CommandAck = Simulink.Bus()
  header: Bus: ContractHeader
  request_id: uint32
  source_session_id: uint32
  request_source_id: uint16
  reserved_source: uint16
  ack_state: uint16
  reason_code: uint16
  completion_time_us: uint64

CommunicationLinkStatus = Simulink.Bus()
  header: Bus: ContractHeader
  link_instance_id: uint32
  link_kind: uint16
  link_state: uint16
  reason_code: uint32
  valid_frame_count: uint32
  sequence_gap_count: uint32
  crc_error_count: uint32
  packet_loss_ppm: uint32
  rssi_dbm: int16
  link_quality_permille: uint16
  last_valid_frame_us: uint64
  last_rx_us: uint64
  recovery_stable_ms: uint32
  flags: uint32

ContractHeader = Simulink.Bus()
  schema_major: uint16
  schema_minor: uint16
  message_type: uint16
  source_id: uint16
  sequence: uint32
  profile_id: uint32
  frame_id: uint32
  boot_id: uint64
  clock_domain_id: uint32
  time_epoch: uint32
  source_clock_domain_id: uint32
  source_mapping_epoch: uint32
  timestamp_sample_us: uint64
  timestamp_publish_us: uint64
  valid_until_us: uint64
  event_time_uncertainty_us: uint32
  timestamp_quality: uint8
  timestamp_flags: uint8
  reserved: uint16
  validity_flags: uint32

ControlCapability = Simulink.Bus()
  header: Bus: ContractHeader
  control_layout_id: uint32
  controllable_dof_mask: uint32
  degraded_dof_mask: uint32
  health_state: uint8
  control_level: uint8
  reason_code: uint16

ControlHealth = Simulink.Bus()
  common: Bus: ModuleHealth
  solver_status: uint32
  deadline_miss_count: uint32
  last_valid_command_us: uint64
  max_input_age_us: uint32
  allocation_failure_count: uint32

ControlLinearModel = Simulink.Bus()
  A: single[36]
  B: single[18]
  c: single[6]
  sample_time_s: single

ControlModelBounds = Simulink.Bus()
  state_min: single[6]
  state_max: single[6]
  input_min: single[3]
  input_max: single[3]
  input_slew_max: single[3]

ControlModelDescriptor = Simulink.Bus()
  model_id: uint32
  model_version: uint32
  state_layout_id: uint32
  input_layout_id: uint32
  model_hash: uint32
  model_kind: uint8
  reserved: uint8[3]

ControlModelInput = Simulink.Bus()
  input: single[3]

ControlModelState = Simulink.Bus()
  state: single[6]

ControlModelView = Simulink.Bus()
  header: Bus: ContractHeader
  descriptor: Bus: ControlModelDescriptor
  linear_model: Bus: ControlLinearModel
  bounds: Bus: ControlModelBounds
  model_epoch: uint32
  operating_point_id: uint32

ControlReasonCode = enum(DataScope="Imported", HeaderFile="common_messages.h", DefaultValue="CONTROL_REASON_NONE")
  CONTROL_REASON_NONE = 0
  CONTROL_REASON_ALLOCATOR_INFEASIBLE = 1793
  CONTROL_REASON_ALLOCATOR_RANK_DEFICIENT = 1794
  CONTROL_REASON_ALLOCATOR_NUMERIC_FAILURE = 1795
  CONTROL_REASON_ACTUATOR_LIMITED = 1796
  CONTROL_REASON_MPC_HOVER_OUTSIDE_APPROX_DOMAIN = 1797

DecisionEvent = Simulink.Bus()
  header: Bus: ContractHeader
  decision_id: uint32
  request_id: uint32
  policy_id: uint32
  evidence_mask: uint32
  decision_code: uint16
  reason_code: uint16

EnvironmentConstraint = Simulink.Bus()
  header: Bus: ContractHeader
  constraint_kind: uint16
  severity: uint16
  constraint_id: uint32
  constraint_expires_at_us: uint64
  payload: Bus: ProductEnvironmentConstraint

EstimatorHealth = Simulink.Bus()
  common: Bus: ModuleHealth
  last_imu_sample_us: uint64
  propagation_age_us: uint32
  rejected_measurement_count: uint32
  covariance_fault_count: uint32

EstimatorResetRequest = Simulink.Bus()
  header: Bus: ContractHeader
  reset_type: uint16
  initial_source: uint16
  requested_origin_id: uint32
  valid_initial_state_mask: uint32
  initial_state: Bus: NavStateCore

ExternalClockSyncObservation = Simulink.Bus()
  source_clock_domain_id: uint32
  source_sequence: uint32
  local_time_epoch: uint32
  reserved0: uint32
  local_send_time_us: uint64
  source_receive_time_ns: uint64
  source_send_time_ns: uint64
  local_receive_time_us: uint64
  source_uncertainty_ns: uint32
  source_reset_counter: uint32
  validity_flags: uint16
  reserved: uint16

ExternalOdometry = Simulink.Bus()
  header: Bus: ContractHeader
  source_origin_id: uint32
  reset_counter: uint32
  tracking_status: uint32
  position_ned_m: single[3]
  velocity_ned_mps: single[3]
  q_nb_wxyz: single[4]
  position_variance_m2: single[3]
  velocity_variance_m2ps2: single[3]
  attitude_variance_rad2: single[3]
  time_sync_uncertainty_us: uint32

FaultEvidenceEvent = Simulink.Bus()
  header: Bus: ContractHeader
  event_id: uint32
  fault_domain: uint16
  evidence_class: uint16
  source_component_id: uint32
  source_instance_id: uint32
  reason_code: uint32
  related_sequence: uint32
  first_seen_us: uint64
  last_seen_us: uint64
  occurrence_count: uint32
  severity: uint8
  active: uint8
  reserved: uint16

FaultSummary = Simulink.Bus()
  header: Bus: ContractHeader
  active_fault_count: uint32
  latched_fault_count: uint32
  fault_domain_mask: uint32
  highest_severity_fault_id: uint32
  highest_severity: uint8
  reserved: uint8[3]

FlowSample = Simulink.Bus()
  header: Bus: ContractHeader
  sensor_instance_id: uint32
  calibration_version: uint32
  quality_flags: uint32
  velocity_xy_mps: single[2]
  integration_time_s: single
  quality: single

FmsHealth = Simulink.Bus()
  header: Bus: ContractHeader
  component_id: uint32
  last_error_code: uint32
  consecutive_error_count: uint32
  last_success_time_us: uint64
  last_heartbeat_time_us: uint64
  health_state: uint8
  reserved: uint8[7]

FmsStateSnapshot = Simulink.Bus()
  header: Bus: ContractHeader
  arm_state: uint8
  flight_mode: uint8
  authority: uint8
  failsafe_level: uint8
  mission_state: uint8
  reserved: uint8[3]
  authority_epoch: uint32
  directive_epoch: uint32
  permit_epoch: uint32
  reference_epoch: uint32
  state_epoch: uint32
  active_mission_id: uint32
  active_policy_id: uint32

GnssSample = Simulink.Bus()
  header: Bus: ContractHeader
  sensor_instance_id: uint32
  sample_sequence: uint32
  calibration_version: uint32
  quality_flags: uint32
  latitude_deg: double
  longitude_deg: double
  altitude_m: single
  velocity_ned_mps: single[3]
  position_variance_m2: single[3]
  velocity_variance_m2ps2: single[3]
  fix_type: uint8
  satellite_count: uint8
  reserved: uint16

GnssTimeObservation = Simulink.Bus()
  utc_time_ns: uint64
  paired_pps_tick64: uint64
  pps_edge_sequence: uint32
  time_epoch: uint32
  receiver_accuracy_ns: uint32
  time_scale: uint16
  validity_flags: uint16

GuidanceFeasibility = Simulink.Bus()
  header: Bus: ContractHeader
  reference_id: uint32
  reference_epoch: uint32
  feasible: uint8
  severity: uint8
  reason_code: uint16
  violated_constraint_id: uint32
  earliest_violation_offset_us: uint32

GuidanceHealth = Simulink.Bus()
  header: Bus: ContractHeader
  component_id: uint32
  last_error_code: uint32
  consecutive_error_count: uint32
  last_success_time_us: uint64
  last_heartbeat_time_us: uint64
  health_state: uint8
  reserved: uint8[7]

GuidanceReasonCode = enum(DataScope="Imported", HeaderFile="common_messages.h", DefaultValue="GUIDANCE_REASON_NONE")
  GUIDANCE_REASON_NONE = 0
  M5_VALIDATION_INPUT_STALE = 1537
  M5_VALIDATION_EPOCH_MISMATCH = 1538
  M5_VALIDATION_FRAME_ORIGIN_MISMATCH = 1539
  M5_VALIDATION_OBSTACLE_INVALID = 1540
  M5_VALIDATION_OBSTACLE_UNKNOWN = 1541
  M5_VALIDATION_GEOFENCE_INVALID = 1542
  M5_VALIDATION_GEOFENCE_VIOLATION = 1543
  M5_VALIDATION_STATIC_COLLISION = 1544
  M5_VALIDATION_DYNAMIC_COLLISION = 1545
  M5_VALIDATION_CLEARANCE_UNPROVEN = 1546
  M5_VALIDATION_UNCERTAINTY_UNBOUNDED = 1547
  M5_VALIDATION_INTERVAL_BUDGET_EXCEEDED = 1548
  M5_VALIDATION_NUMERIC_INVALID = 1549
  M5_VALIDATION_VEHICLE_ENVELOPE_INVALID = 1550
  M5_VALIDATION_REFERENCE_EXPIRED = 1551

GuidanceReferenceKind = enum(DataScope="Imported", HeaderFile="common_messages.h", DefaultValue="GUIDANCE_REFERENCE_NONE")
  GUIDANCE_REFERENCE_NONE = 0
  GUIDANCE_REFERENCE_TRAJECTORY = 1
  GUIDANCE_REFERENCE_PILOT_RATE = 2
  GUIDANCE_REFERENCE_PILOT_ATTITUDE = 3
  GUIDANCE_REFERENCE_ALTITUDE_PILOT = 4
  GUIDANCE_REFERENCE_ALTITUDE_AUTOMATIC = 5

GuidanceRunState = enum(DataScope="Imported", HeaderFile="common_messages.h", DefaultValue="GUIDANCE_STATE_INACTIVE")
  GUIDANCE_STATE_INACTIVE = 0
  GUIDANCE_STATE_READY = 1
  GUIDANCE_STATE_ACTIVE = 2
  GUIDANCE_STATE_HOLDING = 3
  GUIDANCE_STATE_REJECTED = 4
  GUIDANCE_STATE_EXPIRED = 5

GuidanceStatus = Simulink.Bus()
  header: Bus: ContractHeader
  reference_id: uint32
  reference_epoch: uint32
  state_epoch: uint32
  origin_id: uint32
  authority_epoch: uint32
  directive_epoch: uint32
  mission_epoch: uint32
  current_item_id: uint32
  execution_token: uint64
  guidance_state: uint16
  reference_kind: uint16
  reason_code: uint16
  item_result: uint16
  reference_expires_at_us: uint64

ImuSample = Simulink.Bus()
  header: Bus: ContractHeader
  sensor_instance_id: uint32
  sample_sequence: uint32
  calibration_version: uint32
  quality_flags: uint32
  gyro_frd_radps: single[3]
  accel_frd_mps2: single[3]
  temperature_c: single

LandedState = enum(DataScope="Imported", HeaderFile="common_messages.h", DefaultValue="LANDED_STATE_UNKNOWN")
  LANDED_STATE_UNKNOWN = 0
  LANDED_STATE_LANDED = 1
  LANDED_STATE_IN_AIR = 2
  LANDED_STATE_TAKEOFF = 3
  LANDED_STATE_LANDING = 4

LandedStateSnapshot = Simulink.Bus()
  header: Bus: ContractHeader
  state_revision: uint32
  state: uint16
  evidence_mask: uint16
  confidence_0_to_1: single
  stable_duration_ms: uint32
  state_since_us: uint64

LocalTimebaseDisciplineState = enum(DataScope="Imported", HeaderFile="common_base.h", DefaultValue="LOCAL_TIMEBASE_NOMINAL")
  LOCAL_TIMEBASE_NOMINAL = 0
  LOCAL_TIMEBASE_ACQUIRING = 1
  LOCAL_TIMEBASE_LOCKED = 2
  LOCAL_TIMEBASE_HOLDOVER = 3
  LOCAL_TIMEBASE_DEGRADED = 4
  LOCAL_TIMEBASE_INVALID = 5

LocalTimebaseDisciplineStatus = Simulink.Bus()
  time_epoch: uint32
  discipline_epoch: uint32
  anchor_tick64: uint64
  anchor_monotonic_us: uint64
  rate_correction_ppb: int32
  rate_uncertainty_ppb: uint32
  last_phase_error_ns: int64
  last_valid_pps_tick64: uint64
  last_update_monotonic_us: uint64
  accepted_interval_count: uint16
  discipline_state: uint8
  valid: uint8

MagSample = Simulink.Bus()
  header: Bus: ContractHeader
  sensor_instance_id: uint32
  calibration_version: uint32
  quality_flags: uint32
  field_frd_ut: single[3]
  variance_ut2: single[3]

MissionStatus = Simulink.Bus()
  header: Bus: ContractHeader
  mission_id: uint32
  current_item_id: uint32
  mission_epoch: uint32
  mission_revision: uint32
  execution_token: uint64
  mission_state: uint16
  result_code: uint16
  progress_0_to_1: single

MissionUploadCandidate = Simulink.Bus()
  header: Bus: ContractHeader
  transaction_id: uint32
  source_session_id: uint32
  state_epoch: uint32
  origin_id: uint32
  mission_hash: uint32
  mission: Bus: ProductMissionPayload

ModuleHealth = Simulink.Bus()
  header: Bus: ContractHeader
  component_id: uint32
  last_error_code: uint32
  consecutive_error_count: uint32
  last_success_time_us: uint64
  last_heartbeat_time_us: uint64
  health_state: uint8
  reserved: uint8[7]

MotionReference = Simulink.Bus()
  header: Bus: ContractHeader
  reference_id: uint32
  reference_epoch: uint32
  state_epoch: uint32
  origin_id: uint32
  authority_epoch: uint32
  directive_epoch: uint32
  mission_epoch: uint32
  current_item_id: uint32
  execution_token: uint64
  point_count: uint16
  reference_kind: uint16
  reserved: uint32
  anchor: Bus: MotionReferencePoint
  points: Bus: MotionReferencePoint[24]

MotionReferencePoint = Simulink.Bus()
  offset_us: uint32
  valid_mask: uint32
  point: Bus: ProductMotionPoint

NavStateCore = Simulink.Bus()
  valid_mask: uint32
  position_ned_m: single[3]
  velocity_ned_mps: single[3]
  acceleration_ned_mps2: single[3]
  q_nb_wxyz: single[4]
  body_rate_frd_radps: single[3]
  position_std_m: single[3]
  velocity_std_mps: single[3]
  attitude_std_rad: single[3]

NavigationCapability = Simulink.Bus()
  header: Bus: ContractHeader
  state_epoch: uint32
  origin_id: uint32
  capability_mask: uint32
  degraded_mask: uint32
  solution_state: uint8
  reserved: uint8[3]
  horizontal_position_std_m: single
  vertical_position_std_m: single
  velocity_std_mps: single
  heading_std_rad: single
  active_source_mask: uint32
  rejected_source_mask: uint32

NavigationOriginSnapshot = Simulink.Bus()
  header: Bus: ContractHeader
  origin_id: uint32
  state_epoch: uint32
  valid_mask: uint32
  reserved: uint32
  latitude_deg: double
  longitude_deg: double
  ellipsoid_height_m: double
  geoid_separation_m: single
  local_radius_limit_m: single

NavigationSnapshot = Simulink.Bus()
  header: Bus: ContractHeader
  state_epoch: uint32
  origin_id: uint32
  core: Bus: NavStateCore
  vehicle_extension: Bus: ProductNavExtension

OperatingPoint = Simulink.Bus()
  state: Bus: ControlModelState
  input: Bus: ControlModelInput
  operating_speed_mps: single
  operating_voltage_v: single

OperationRequest = Simulink.Bus()
  header: Bus: ContractHeader
  request_id: uint32
  source_session_id: uint32
  command_code: uint16
  authority_class: uint16
  payload_schema_id: uint16
  reserved: uint16
  execution_deadline_us: uint64
  payload: Bus: ProductOperationPayload

OperatorInput = Simulink.Bus()
  header: Bus: ContractHeader
  input_layout_id: uint32
  valid_axis_mask: uint32
  payload: Bus: ProductOperatorInput

PilotControlReference = Simulink.Bus()
  header: Bus: ContractHeader
  reference_id: uint32
  reference_epoch: uint32
  state_epoch: uint32
  origin_id: uint32
  authority_epoch: uint32
  directive_epoch: uint32
  reference_kind: uint16
  valid_mask: uint16
  vehicle_extension: Bus: ProductPilotControlReferencePayload

PilotReferenceKind = enum(DataScope="Imported", HeaderFile="common_messages.h", DefaultValue="PILOT_REFERENCE_NONE")
  PILOT_REFERENCE_NONE = 0
  PILOT_REFERENCE_RATE = 1
  PILOT_REFERENCE_ATTITUDE = 2
  PILOT_REFERENCE_ALTITUDE_ATTITUDE = 3

PpsCaptureEvent = Simulink.Bus()
  capture_tick64: uint64
  edge_sequence: uint32
  time_epoch: uint32
  capture_flags: uint16
  reserved: uint16

PreArmCheckResult = Simulink.Bus()
  header: Bus: ContractHeader
  check_epoch: uint32
  failed_checks_mask: uint32
  state: uint16
  primary_reason_code: uint16
  failed_count: uint16
  warning_count: uint16
  checked_at_us: uint64

PreArmState = enum(DataScope="Imported", HeaderFile="common_messages.h", DefaultValue="PREARM_NOT_RUN")
  PREARM_NOT_RUN = 0
  PREARM_RUNNING = 1
  PREARM_READY = 2
  PREARM_REJECT = 3

ProductActuatorCapability = Simulink.Bus()
  min_thrust_n: single[4]
  max_thrust_n: single[4]
  max_slew_nps: single[4]

ProductActuatorConfig = Simulink.Bus()
  profile_hash: uint32
  calibration_set_id: uint32
  calibration_hash: uint32
  config_version: uint32
  payload: Bus: ProductActuatorConfigPayload

ProductActuatorConfigPayload = Simulink.Bus()
  output_policy_id: uint32
  esc_bit_rate: uint32
  calibration_version: uint32
  motor_to_timer_channel: uint8[4]
  thrust_curve_count: uint16[4]
  thrust_curve_n: single[4 16]
  dshot_curve_code: uint16[4 16]
  min_thrust_n: single[4]
  max_thrust_n: single[4]
  max_slew_nps: single[4]

ProductActuatorDemand = Simulink.Bus()
  valid_mask: uint32
  motor_thrust_n: single[4]

ProductActuatorFeedback = Simulink.Bus()
  valid_mask: uint32
  motor_rpm: single[4]
  motor_thrust_est_n: single[4]

ProductControllerConfig = Simulink.Bus()
  profile_hash: uint32
  parameter_set_id: uint32
  parameter_hash: uint32
  config_version: uint32
  payload: Bus: ProductControllerConfigPayload

ProductControllerConfigPayload = Simulink.Bus()
  mass_kg: single
  inertia_frd_kgm2: single[9]
  motor_position_frd_m: single[4 3]
  motor_yaw_torque_ratio_m: single[4]
  so3_gain_per_s: single[3]
  rate_kp_nm_per_radps: single[3]
  rate_ki_nm_per_rad: single[3]
  rate_kd_nm_per_radps2: single[3]
  rate_kaw_per_s: single[3]
  rate_d_cutoff_hz: single
  rate_integral_limit_nm: single[3]
  fallback_kp_per_s2: single[3]
  fallback_kd_per_s: single[3]
  mpc_q_diag: single[6]
  mpc_qf_diag: single[6]
  mpc_r_diag: single[3]
  mpc_s_diag: single[3]
  actuation_preview_delay_s: single
  manual_hover_throttle_norm: single
  mpc_seed_position_error_limit_m: single
  mpc_seed_velocity_error_limit_mps: single

ProductDirectivePayload = Simulink.Bus()
  flight_phase: uint8
  failsafe_policy: uint8
  reserved: uint16
  max_tilt_rad: single
  min_height_above_home_m: single
  max_height_above_home_m: single
  home: Bus: ProductHomeTargetSnapshot
  target_valid_mask: uint32
  target_position_ned_m: single[3]
  target_yaw_rad: single

ProductEnvironmentConstraint = Simulink.Bus()
  obstacle_count: uint32
  min_clearance_m: single
  max_wind_mps: single

ProductEnvironmentState = Simulink.Bus()
  wind_ned_mps: single[3]
  air_density_kgpm3: single

ProductEstimatorConfig = Simulink.Bus()
  profile_hash: uint32
  parameter_set_id: uint32
  parameter_hash: uint32
  config_version: uint32
  payload: Bus: ProductEstimatorConfigPayload

ProductEstimatorConfigPayload = Simulink.Bus()
  initial_covariance_upper: double[253]
  gyro_noise_density_radps_per_sqrt_hz: double[3]
  accel_noise_density_mps2_per_sqrt_hz: double[3]
  gyro_bias_std_radps: double[3]
  accel_bias_std_mps2: double[3]
  gyro_scale_std: double[3]
  accel_scale_std: double[3]
  bias_correlation_time_s: double[2]
  scale_correlation_time_s: double[2]
  baro_bias_rw_psd_m2ps: double
  gnss_position_floor_m: double[3]
  gnss_velocity_floor_mps: double[3]
  baro_floor_m: double
  mag_heading_floor_rad: double
  antenna_lever_frd_m: double[3]
  imu_to_vehicle_reference_frd_m: double[3]
  magnetic_declination_rad: double
  magnetic_declination_variance_rad2: double
  min_horizontal_field_ut: double
  initial_latitude_deg: double
  initial_longitude_deg: double
  initial_ellipsoid_height_m: double
  local_radius_limit_m: single
  initial_origin_valid_mask: uint32
  aiding_mask: uint32
  calibration_version: uint32

ProductFmsConfig = Simulink.Bus()
  profile_hash: uint32
  parameter_set_id: uint32
  parameter_hash: uint32
  config_version: uint32
  payload: Bus: ProductFmsConfigPayload

ProductFmsConfigPayload = Simulink.Bus()
  safety_policy_id: uint32
  output_policy_id: uint32
  verified_input_mask: uint32
  rc_lost_timeout_us: uint32
  rc_recovery_dwell_us: uint32
  landed_dwell_us: uint32
  first_reference_timeout_us: uint32
  nav_enter_dwell_us: uint32
  attitude_std_limit_rad: single
  heading_std_limit_rad: single
  horizontal_position_std_limit_m: single
  vertical_position_std_limit_m: single
  horizontal_velocity_std_limit_mps: single
  vertical_velocity_std_limit_mps: single
  nav_enter_ratio: single
  geofence_required: uint32

ProductFmsInputExtension = Simulink.Bus()
  header: Bus: ContractHeader
  valid_mask: uint32
  ground_contact_state: uint8
  landing_zone_valid: uint8
  geofence_state: uint8
  energy_state: uint8
  battery_remaining_fraction: single
  estimated_return_energy_fraction: single
  estimated_landing_energy_fraction: single
  wind_ned_mps: single[3]
  wind_uncertainty_mps: single

ProductGeofenceConfig = Simulink.Bus()
  profile_hash: uint32
  config_version: uint32
  geofence_hash: uint32
  payload: Bus: ProductGeofenceConfigPayload

ProductGeofenceConfigPayload = Simulink.Bus()
  config_version: uint32
  fence_count: uint32
  geofence_hash: uint32
  fences: Bus: ProductGeofenceDefinition[4]

ProductGeofenceDefinition = Simulink.Bus()
  fence_id: uint32
  kind: uint8
  vertex_count: uint8
  reserved0: uint16
  vertices_ne_m: single[32 2]
  min_height_above_home_m: single
  max_height_above_home_m: single
  horizontal_margin_m: single
  vertical_margin_m: single

ProductGeofenceKind = enum(DataScope="Imported", HeaderFile="product_contract.h", DefaultValue="PRODUCT_GEOFENCE_KEEP_IN")
  PRODUCT_GEOFENCE_KEEP_IN = 1
  PRODUCT_GEOFENCE_KEEP_OUT = 2

ProductGeofenceSnapshot = Simulink.Bus()
  header: Bus: ContractHeader
  fence_id: uint32
  fence_revision: uint32
  fence_hash: uint32
  frame_id: uint32
  origin_id: uint32
  state_epoch: uint32
  validity: uint8
  kind: uint8
  vertex_count: uint8
  reserved0: uint8
  vertices_ne_m: single[32 2]
  min_height_above_home_m: single
  max_height_above_home_m: single
  horizontal_margin_m: single
  vertical_margin_m: single

ProductGeofenceValidity = enum(DataScope="Imported", HeaderFile="product_contract.h", DefaultValue="PRODUCT_GEOFENCE_INVALID")
  PRODUCT_GEOFENCE_INVALID = 0
  PRODUCT_GEOFENCE_VALID = 1

ProductGuidanceConfig = Simulink.Bus()
  profile_hash: uint32
  parameter_set_id: uint32
  parameter_hash: uint32
  config_version: uint32
  payload: Bus: ProductGuidanceConfigPayload

ProductGuidanceConfigPayload = Simulink.Bus()
  max_velocity_ned_mps: single[3]
  max_acceleration_ned_mps2: single[3]
  max_jerk_ned_mps3: single[3]
  vehicle_radius_m: single
  clearance_margin_m: single
  uncertainty_inflation_factor: single
  obstacle_source_mode: uint32
  planning_deadline_us: uint32
  primitive_table_version: uint32
  max_dynamic_prediction_us: uint32
  mass_kg: single
  gravity_mps2: single

ProductHomeCaptureSource = enum(DataScope="Imported", HeaderFile="product_contract.h", DefaultValue="PRODUCT_HOME_CAPTURE_AUTO_ARM")
  PRODUCT_HOME_CAPTURE_AUTO_ARM = 1
  PRODUCT_HOME_CAPTURE_OPERATOR = 2

ProductHomeQuality = enum(DataScope="Imported", HeaderFile="product_contract.h", DefaultValue="PRODUCT_HOME_QUALITY_GOOD")
  PRODUCT_HOME_QUALITY_GOOD = 0
  PRODUCT_HOME_QUALITY_DEGRADED = 1

ProductHomeTargetSnapshot = Simulink.Bus()
  home_id: uint32
  home_revision: uint32
  frame_id: uint32
  origin_id: uint32
  state_epoch: uint32
  validity: uint8
  quality: uint8
  capture_source: uint8
  reserved0: uint8
  captured_at_us: uint64
  home_expires_at_us: uint64
  position_ned_m: single[3]
  position_std_m: single[3]

ProductHomeValidity = enum(DataScope="Imported", HeaderFile="product_contract.h", DefaultValue="PRODUCT_HOME_INVALID")
  PRODUCT_HOME_INVALID = 0
  PRODUCT_HOME_VALID = 1

ProductMissionPayload = Simulink.Bus()
  mission_id: uint32
  mission_revision: uint32
  mission_hash: uint32
  waypoint_count: uint16
  flags: uint16
  waypoints: Bus: ProductMissionWaypoint[32]

ProductMissionWaypoint = Simulink.Bus()
  waypoint_id: uint32
  position_ned_m: single[3]
  yaw_rad: single
  acceptance_radius_m: single
  speed_limit_mps: single
  flags: uint32

ProductMotionPoint = Simulink.Bus()
  valid_mask: uint32
  position_ned_m: single[3]
  velocity_ned_mps: single[3]
  acceleration_ned_mps2: single[3]
  yaw_rad: single
  yaw_rate_radps: single

ProductNavExtension = Simulink.Bus()
  valid_mask: uint32
  baro_altitude_m: single
  terrain_range_m: single
  wind_ned_mps: single[3]

ProductObstacleObservation = Simulink.Bus()
  header: Bus: ContractHeader
  observation_id: uint32
  sensor_instance_id: uint32
  source_health_epoch: uint32
  origin_id: uint32
  state_epoch: uint32
  observation_kind: uint16
  shape_kind: uint16
  source_health: uint8
  reserved0: uint8[3]
  quality_flags: uint32
  obstacle_center_ned_m: single[3]
  obstacle_half_extent_m: single[3]
  ray_start_ned_m: single[3]
  ray_end_ned_m: single[3]
  obstacle_velocity_ned_mps: single[3]
  position_std_m: single[3]
  velocity_std_mps: single[3]
  confidence_0_to_1: single

ProductObstacleObservationKind = enum(DataScope="Imported", HeaderFile="product_contract.h", DefaultValue="PRODUCT_OBS_OCCUPIED_PRIMITIVE")
  PRODUCT_OBS_OCCUPIED_PRIMITIVE = 1
  PRODUCT_OBS_FREE_SPACE_RAY = 2

ProductObstacleShape = enum(DataScope="Imported", HeaderFile="product_contract.h", DefaultValue="PRODUCT_OBS_SHAPE_POINT")
  PRODUCT_OBS_SHAPE_POINT = 1
  PRODUCT_OBS_SHAPE_SPHERE = 2
  PRODUCT_OBS_SHAPE_AABB = 3

ProductObstacleSourceHealth = enum(DataScope="Imported", HeaderFile="product_contract.h", DefaultValue="PRODUCT_OBS_SOURCE_NORMAL")
  PRODUCT_OBS_SOURCE_NORMAL = 0
  PRODUCT_OBS_SOURCE_DEGRADED = 1
  PRODUCT_OBS_SOURCE_REJECT = 2

ProductOperationPayload = Simulink.Bus()
  mission_id: uint32
  target_ned_m: single[3]
  target_yaw_rad: single
  requested_altitude_m: single
  valid_mask: uint32
  requested_mode: uint16
  operation_flags: uint16
  settings_transaction_id: uint32
  prearm_check_epoch: uint32
  mission_transaction_id: uint32
  mission_epoch: uint32

ProductOperatorInput = Simulink.Bus()
  roll_norm: single
  pitch_norm: single
  yaw_norm: single
  throttle_norm: single
  mode_switch_bits: uint32
  aux_switch_bits: uint32

ProductPilotControlReferencePayload = Simulink.Bus()
  valid_mask: uint32
  body_rate_frd_radps: single[3]
  q_nb_desired_wxyz: single[4]
  yaw_rate_ff_radps: single
  collective_throttle_norm: single
  altitude_above_origin_m: single
  vertical_velocity_up_mps: single

ProductPlantInitialState = Simulink.Bus()
  position_ned_m: single[3]
  velocity_ned_mps: single[3]
  q_nb_wxyz: single[4]
  body_rate_frd_radps: single[3]
  motor_omega_radps: single[4]

ProductPlantTruth = Simulink.Bus()
  position_ned_m: single[3]
  velocity_ned_mps: single[3]
  q_nb_wxyz: single[4]
  body_rate_frd_radps: single[3]
  motor_omega_radps: single[4]

ProductSafetyEnvelopePayload = Simulink.Bus()
  valid_mask: uint32
  max_velocity_ned_mps: single[3]
  max_acceleration_ned_mps2: single[3]
  max_jerk_ned_mps3: single[3]
  max_tilt_rad: single
  min_total_thrust_n: single
  max_total_thrust_n: single
  max_body_rate_frd_radps: single[3]
  min_height_above_home_m: single
  max_height_above_home_m: single

QuadSensorProcessingConfig = Simulink.Bus()
  config_version: uint32
  calibration_version: uint32
  imu_to_frd_rotation: double[9]
  mag_to_frd_rotation: double[9]
  imu_bias_gyro_radps: double[3]
  imu_bias_accel_mps2: double[3]
  imu_scale_gyro: double[3]
  imu_scale_accel: double[3]
  mag_hard_iron_ut: double[3]
  mag_soft_iron_matrix: double[9]
  imu_axis_delay_us: single[6]
  imu_delay_uncertainty_us: single[6]
  baro_delay_us: single
  baro_delay_uncertainty_us: single
  mag_delay_us: single
  mag_delay_uncertainty_us: single
  verified_sensor_mask: uint32
  reserved: uint32

RangeSample = Simulink.Bus()
  header: Bus: ContractHeader
  sensor_instance_id: uint32
  calibration_version: uint32
  quality_flags: uint32
  range_m: single
  variance_m2: single

RawIngressBatchDescriptor = Simulink.Bus()
  boot_id: uint64
  time_epoch: uint32
  source_mapping_epoch: uint32
  capture_ticks64: uint64
  capture_time_us: uint64
  dma_start_time_us: uint64
  dma_complete_time_us: uint64
  spi_eot_time_us: uint64
  event_sequence: uint32
  sensor_instance_id: uint32
  generation: uint32
  clock_domain_id: uint32
  acquisition_flags: uint32
  event_time_uncertainty_us: uint32
  payload_length_bytes: uint16
  sample_count: uint16
  timestamp_quality: uint8
  reserved: uint8[3]

SafetyEnvelope = Simulink.Bus()
  header: Bus: ContractHeader
  safety_envelope_id: uint32
  envelope_epoch: uint32
  max_linear_speed_mps: single
  max_linear_accel_mps2: single
  max_angular_rate_radps: single
  max_yaw_rate_radps: single
  vehicle_extension: Bus: ProductSafetyEnvelopePayload

SensorConsistencyEvidence = Simulink.Bus()
  header: Bus: ContractHeader
  sensor_instance_id: uint32
  policy_epoch: uint32
  state_epoch: uint32
  calibration_version: uint32
  window_duration_us: uint32
  evaluated_count: uint16
  accepted_count: uint16
  rejected_count: uint16
  probation_pass_count: uint16
  evidence_flags: uint32
  reason_code: uint16
  evaluation_mode: uint16
  last_evaluated_sample_time_us: uint64
  evidence_expires_at_us: uint64

SensorConsistencyReason = enum(DataScope="Imported", HeaderFile="common_messages.h", DefaultValue="SENSOR_CONSISTENCY_REASON_NONE")
  SENSOR_CONSISTENCY_REASON_NONE = 0
  SENSOR_CONSISTENCY_REASON_POLICY_DISABLED = 1
  SENSOR_CONSISTENCY_REASON_TIME_NOT_READY = 2
  SENSOR_CONSISTENCY_REASON_CALIBRATION_NOT_READY = 3
  SENSOR_CONSISTENCY_REASON_INSUFFICIENT_SAMPLES = 4
  SENSOR_CONSISTENCY_REASON_NUMERIC_FAILURE = 5
  SENSOR_CONSISTENCY_REASON_INCONSISTENT = 6
  SENSOR_CONSISTENCY_REASON_EVIDENCE_TIMEOUT = 7
  SENSOR_CONSISTENCY_REASON_VERSION_MISMATCH = 8

SensorDataGapEvent = Simulink.Bus()
  header: Bus: ContractHeader
  sensor_instance_id: uint32
  first_missing_sequence: uint32
  last_missing_sequence: uint32
  reason_code: uint32
  last_good_sample_time_us: uint64
  next_sample_time_us: uint64

SensorDiagnostic = Simulink.Bus()
  header: Bus: ContractHeader
  sensor_instance_id: uint32
  diagnostic_class: uint16
  severity: uint8
  flags: uint8
  reason_code: uint32
  occurrence_count: uint32
  last_good_sample_us: uint64

SensorUsePolicy = Simulink.Bus()
  header: Bus: ContractHeader
  sensor_instance_id: uint32
  policy_epoch: uint32
  use_state: uint16
  reason_code: uint16
  degraded_noise_profile_id: uint32
  evaluation_flags: uint32
  effective_time_us: uint64
  policy_expires_at_us: uint64

StateResetEvent = Simulink.Bus()
  header: Bus: ContractHeader
  old_state_epoch: uint32
  new_state_epoch: uint32
  old_origin_id: uint32
  new_origin_id: uint32
  reset_type: uint16
  reserved: uint16
  position_delta_m: single[3]
  velocity_delta_mps: single[3]
  attitude_delta_rad: single[3]

Status = Simulink.AliasType(BaseType="int32", DataScope="Imported", HeaderFile="common_base.h")

TimeQuality = enum(DataScope="Imported", HeaderFile="common_base.h", DefaultValue="TIME_QUALITY_LOCAL_ONLY")
  TIME_QUALITY_LOCAL_ONLY = 0
  TIME_QUALITY_ACQUIRING = 1
  TIME_QUALITY_LOCKED = 2
  TIME_QUALITY_HOLDOVER = 3
  TIME_QUALITY_DEGRADED = 4
  TIME_QUALITY_INVALID = 5

TimeReferenceSource = enum(DataScope="Imported", HeaderFile="common_base.h", DefaultValue="TIME_REF_NONE")
  TIME_REF_NONE = 0
  TIME_REF_GNSS_PPS = 1
  TIME_REF_RTC = 2
  TIME_REF_COMPANION = 3
  TIME_REF_HARDWARE_SYNC = 4

TimeServiceStatus = Simulink.Bus()
  monotonic_now_us: uint64
  utc_estimate_ns: uint64
  utc_uncertainty_ns: uint64
  holdover_duration_us: uint64
  last_valid_pps_us: uint64
  last_valid_reference_us: uint64
  estimated_frequency_error_ppb: int32
  clock_domain_id: uint32
  time_epoch: uint32
  utc_mapping_epoch: uint32
  status_flags: uint32
  state: uint8
  reference_source: uint8
  utc_valid: uint8
  local_clock_valid: uint8
  frequency_discipline_valid: uint8
  reserved: uint8[3]

TimerCaptureEvent = Simulink.Bus()
  boot_id: uint64
  capture_ticks64: uint64
  capture_time_us: uint64
  time_epoch: uint32
  discipline_epoch: uint32
  edge_sequence: uint32
  event_time_uncertainty_us: uint32
  timer_instance: uint16
  channel: uint8
  flags: uint8

TimestampQuality = enum(DataScope="Imported", HeaderFile="common_base.h", DefaultValue="TIMESTAMP_QUALITY_INVALID")
  TIMESTAMP_QUALITY_INVALID = 0
  TIMESTAMP_QUALITY_HARDWARE_CAPTURED = 1
  TIMESTAMP_QUALITY_SENSOR_MODEL_CORRECTED = 2
  TIMESTAMP_QUALITY_EXTERNAL_MAPPED = 3
  TIMESTAMP_QUALITY_RECEIVE_TIME_ESTIMATED = 4

VehicleDirective = Simulink.Bus()
  header: Bus: ContractHeader
  directive_epoch: uint32
  authority_epoch: uint32
  state_epoch: uint32
  policy_id: uint32
  operation_code: uint16
  guidance_mode_code: uint16
  reason_code: uint16
  reserved: uint16
  directive_expires_at_us: uint64
  required_nav_capabilities: uint32
  safety_envelope_id: uint32
  payload: Bus: ProductDirectivePayload

WaterSpeedSample = Simulink.Bus()
  header: Bus: ContractHeader
  sensor_instance_id: uint32
  calibration_version: uint32
  quality_flags: uint32
  water_speed_mps: single
  variance_m2ps2: single

WheelOdometrySample = Simulink.Bus()
  header: Bus: ContractHeader
  sensor_instance_id: uint32
  calibration_version: uint32
  quality_flags: uint32
  wheel_speed_mps: single[4]
  steering_angle_rad: single

enum_A5F2Auhpg3LqJM35J99ziB = enum(DataScope="Imported", HeaderFile="common_base.h", DefaultValue="STATUS_OK")
  STATUS_OK = 0
  STATUS_INVALID_ARGUMENT = -1
  STATUS_NOT_READY = -2
  STATUS_OUT_OF_RANGE = -3
  STATUS_UNSUPPORTED = -4
  STATUS_NUMERIC_ERROR = -5
  STATUS_DEADLINE_MISSED = -6
  STATUS_PROFILE_MISMATCH = -7
  STATUS_MODEL_OUT_OF_DOMAIN = -8
  STATUS_BUFFER_FULL = -9
  STATUS_STALE_DATA = -10
  STATUS_NOT_PERMITTED = -11

enum_l770dSwpLJLlQbAn30IUbE = enum(DataScope="Imported", HeaderFile="common_messages.h", DefaultValue="LINK_STATE_UNKNOWN")
  LINK_STATE_UNKNOWN = 0
  LINK_STATE_INITIALIZING = 1
  LINK_STATE_HEALTHY = 2
  LINK_STATE_DEGRADED = 3
  LINK_STATE_LOST = 4
  LINK_STATE_RECOVERING = 5

enum_z9RB7uYkLG3WPRghlPqOEB = enum(DataScope="Imported", HeaderFile="common_messages.h", DefaultValue="LINK_FLAG_RECEIVER_FAILSAFE")
  LINK_FLAG_RECEIVER_FAILSAFE = 1
  LINK_FLAG_INTERFERENCE_SUSPECTED = 2
  LINK_FLAG_TIME_UNCERTAIN = 4
  LINK_FLAG_AUTHENTICATION_ERRORS = 8