% Simulink data dictionary Flight_Parameters.sldd

AllocationGeometry = [0.225; 0.02]

EstimatorP0 = [0.25 0 0 0 0 0 0 0 0 0 0 0 0 0 0 0 0 0 0 0 0 0
 0 0.25 0 0 0 0 0 0 0 0 0 0 0 0 0 0 0 0 0 0 0 0
 0 0 0.25 0 0 0 0 0 0 0 0 0 0 0 0 0 0 0 0 0 0 0
 0 0 0 0.01 0 0 0 0 0 0 0 0 0 0 0 0 0 0 0 0 0 0
 0 0 0 0 0.01 0 0 0 0 0 0 0 0 0 0 0 0 0 0 0 0 0
 0 0 0 0 0 0.01 0 0 0 0 0 0 0 0 0 0 0 0 0 0 0 0
 0 0 0 0 0 0 0.0003046174 0 0 0 0 0 0 0 0 0 0 0 0 0 0 0
 0 0 0 0 0 0 0 0.0003046174 0 0 0 0 0 0 0 0 0 0 0 0 0 0
 0 0 0 0 0 0 0 0 0.007615435 0 0 0 0 0 0 0 0 0 0 0 0 0
 0 0 0 0 0 0 0 0 0 1.0e-6 0 0 0 0 0 0 0 0 0 0 0 0
 0 0 0 0 0 0 0 0 0 0 1.0e-6 0 0 0 0 0 0 0 0 0 0 0
 0 0 0 0 0 0 0 0 0 0 0 1.0e-6 0 0 0 0 0 0 0 0 0 0
 0 0 0 0 0 0 0 0 0 0 0 0 0.0004 0 0 0 0 0 0 0 0 0
 0 0 0 0 0 0 0 0 0 0 0 0 0 0.0004 0 0 0 0 0 0 0 0
 0 0 0 0 0 0 0 0 0 0 0 0 0 0 0.0004 0 0 0 0 0 0 0
 0 0 0 0 0 0 0 0 0 0 0 0 0 0 0 1.0e-8 0 0 0 0 0 0
 0 0 0 0 0 0 0 0 0 0 0 0 0 0 0 0 1.0e-8 0 0 0 0 0
 0 0 0 0 0 0 0 0 0 0 0 0 0 0 0 0 0 1.0e-8 0 0 0 0
 0 0 0 0 0 0 0 0 0 0 0 0 0 0 0 0 0 0 1.0e-8 0 0 0
 0 0 0 0 0 0 0 0 0 0 0 0 0 0 0 0 0 0 0 1.0e-8 0 0
 0 0 0 0 0 0 0 0 0 0 0 0 0 0 0 0 0 0 0 0 1.0e-8 0
 0 0 0 0 0 0 0 0 0 0 0 0 0 0 0 0 0 0 0 0 0 0.25]

EstimatorQc = [4e-07 0 0 0 0 0 0 0 0 0 0 0 0 0 0 0 0 0 0
 0 4e-07 0 0 0 0 0 0 0 0 0 0 0 0 0 0 0 0 0
 0 0 4e-07 0 0 0 0 0 0 0 0 0 0 0 0 0 0 0 0
 0 0 0 1.0e-9 0 0 0 0 0 0 0 0 0 0 0 0 0 0 0
 0 0 0 0 1.0e-9 0 0 0 0 0 0 0 0 0 0 0 0 0 0
 0 0 0 0 0 1.0e-9 0 0 0 0 0 0 0 0 0 0 0 0 0
 0 0 0 0 0 0 5.555556e-12 0 0 0 0 0 0 0 0 0 0 0 0
 0 0 0 0 0 0 0 5.555556e-12 0 0 0 0 0 0 0 0 0 0 0
 0 0 0 0 0 0 0 0 5.555556e-12 0 0 0 0 0 0 0 0 0 0
 0 0 0 0 0 0 0 0 0 2.222222e-09 0 0 0 0 0 0 0 0 0
 0 0 0 0 0 0 0 0 0 0 2.222222e-09 0 0 0 0 0 0 0 0
 0 0 0 0 0 0 0 0 0 0 0 2.222222e-09 0 0 0 0 0 0 0
 0 0 0 0 0 0 0 0 0 0 0 0 2.222222e-13 0 0 0 0 0 0
 0 0 0 0 0 0 0 0 0 0 0 0 0 2.222222e-13 0 0 0 0 0
 0 0 0 0 0 0 0 0 0 0 0 0 0 0 2.222222e-13 0 0 0 0
 0 0 0 0 0 0 0 0 0 0 0 0 0 0 0 2.222222e-13 0 0 0
 0 0 0 0 0 0 0 0 0 0 0 0 0 0 0 0 2.222222e-13 0 0
 0 0 0 0 0 0 0 0 0 0 0 0 0 0 0 0 0 2.222222e-13 0
 0 0 0 0 0 0 0 0 0 0 0 0 0 0 0 0 0 0 0.0001]

FrameQuantizerParameters = [10; 100]
GravityMps2 = 9.80665
MotorKf = 1.0e-5
MotorMaxN = [15; 15; 15; 15]
MotorTau = 0.03
PlantParameters = [1.5; 0.025; 0.025; 0.04; 1.0e-5; 0.03; 0.1; 0.1; 0.15; 0.002; 5000; 100; 0.15; 0; 0; 0.15; 9.80665; 0.12; 0.12; 0.7]
PlantState0 = [0; 0; 0; 0; 0; 0; 1; 0; 0; 0; 0; 0; 0; 0; 0; 0; 0]
PlantStepS = 0.0005
RateDcutoff = 30
RateIlimit = [0.08; 0.08; 0.05]
RateKaw = [5; 5; 5]
RateKd = [0.002; 0.002; 0.001]
RateKi = [0.08; 0.08; 0.04]
RateKp = [0.16; 0.16; 0.12]

WrenchMatrix = [0 0 0 0
 0 0 0 0
 -1 -1 -1 -1
 0.18 -0.18 -0.18 0.18
 0.18 0.18 -0.18 -0.18
 -0.02 0.02 -0.02 0.02]